# Grasshopper definition Grasshopper Workhop.gh (Grasshopper 1.0.7)

# ---- group: Y軸方向の距離
fy = Slider(100000, range=0..100000)

# ---- group: X軸方向の距離
fx = Slider(65000, range=0..100000)

# ---- group: 第2円弧半径
R = Slider(57940, range=0..100000)

# ----
subtraction = Subtraction(A=fx, B=R)
neg = Negative(Value=fx)
subtraction_2 = Subtraction(A=fy, B=R)
neg_2 = Negative(Value=subtraction)
pt = PointOriented(BasePlane=PlaneXY(0, 0, 0), UComponent=neg, VComponent=0, WComponent=0)
pt_2 = PointOriented(BasePlane=PlaneXY(0, 0, 0), UComponent=neg_2, VComponent=0, WComponent=0)
pt_3 = PointOriented(BasePlane=PlaneXY(0, 0, 0), UComponent=0, VComponent=subtraction_2, WComponent=0)
pt_4 = PointOriented(BasePlane=PlaneXY(0, 0, 0), UComponent=0, VComponent=fy, WComponent=0)

# ---- group: 見た目用
pt_5 = ConstructPoint(XCoordinate=0, YCoordinate=0, ZCoordinate=0)
ln = Line(StartPoint=pt_4, EndPoint=pt_5)

# ----
# グループ化してコピーで使った方が扱いやすい
panel = Panel("FX")
tag = TextTag3D(
    Location=pt,
    Text=panel,
    Size=Slider(7000, range=0..10000),
    Colour=ColourSwatch(SwatchColor=RGB(8, 0, 255)),
    Justification=7)

tag_2 = TextTag3D(
    Location=pt_4,
    Text="FY",
    Size=Slider(7000, range=0..10000),
    Colour=ColourSwatch(SwatchColor=RGB(8, 0, 255)),
    Justification=7)

ln_2 = Line(StartPoint=pt_2, EndPoint=pt_3)
pframe = PerpFrame(Curve=reparameterize(ln_2), Parameter="0.5")
mirror = Mirror(Geometry=pt, Plane=pframe)  # -> Geometry, Transform
X = UnitX(Factor=1)
Y = UnitY(Factor=1)
rev = Reverse(Vector=X)
arc = ArcSED(Start=pt_4, End=mirror.Geometry, Direction=rev)  # -> Arc, Plane, Radius
arc_2 = ArcSED(Start=pt, End=mirror.Geometry, Direction=Y)  # -> Arc, Plane, Radius

# ---- group: 見た目用
ln_3 = Line(StartPoint=pt, EndPoint=pt_2)
ln_4 = Line(StartPoint=mirror.Geometry, EndPoint=pt_3)

number_slider = Slider(1000000, range=0..1000000)
ext = ExtendCurve(Curve=ln_4, Type=0, Start="0", End=number_slider)
ext_2 = ExtendCurve(Curve=ln_3, Type=0, Start="0", End=number_slider)

# ----
flip = FlipCurve(Curve=arc.Arc)  # -> Curve, Flag
midpt = CurveMiddle(Curve=arc.Arc)
midpt_2 = CurveMiddle(Curve=arc_2.Arc)

# ----
# フォーカルライン（円弧）
tag_3 = TextTag3D(
    Location=midpt_2,
    Text="①",
    Size=Slider(7000, range=0..10000),
    Colour=ColourSwatch(SwatchColor=RGB(8, 0, 255)),
    Justification=7)

tag_4 = TextTag3D(
    Location=midpt,
    Text="②",
    Size=Slider(7000, range=0..10000),
    Colour=ColourSwatch(SwatchColor=RGB(8, 0, 255)),
    Justification=7)

# ---- group: 第1円弧
crv = Curve(arc_2.Arc)

# ---- group: 第2円弧
crv_2 = Curve(flip.Curve)

# ---- group: 本来は最前列の長さや最上段の長さをもとに分割数を出す。
# 割り算の分母は０にならないように設定しておく
number_slider_2 = Slider(7820, range=4000..30000)

# ---- group: 第1円弧
crv_3 = Curve(crv)

# ---- group: 第2円弧
crv_4 = Curve(crv_2)

# ----
# コピーの数が少なければデザイングループとして扱う。多い時はクラスター化も考え始める
len = Length(Curve=crv_3)
darc = DeconstructArc(Arc=crv_3)  # -> BasePlane, Radius, Angle
division = Division(A=len, B=number_slider_2)
round = Round(Number=division)  # -> Nearest, Floor, Ceiling
divide = DivideCurve(Curve=crv_3, Count=round.Floor, Kinks=False)  # -> Points, Tangents, Parameters
pline = PolyLine(Vertices=divide.Points, Closed=False)
pt_6 = Point(divide.Points)
explode = Explode(Curve=pline, Recursive=True)  # -> Segments, Vertices
midpt_3 = CurveMiddle(Curve=explode.Segments)
pt_7 = Point(darc.BasePlane)
vec2pt = Vector2Pt(PointA=pt_7, PointB=midpt_3, Unitize=False)  # -> Vector, Length
dist = Distance(PointA=pt_7, PointB=midpt_3)
division_2 = Division(A=darc.Radius, B=dist)
multiplication = Multiplication(A=darc.Radius, B=division_2)
subtraction_3 = Subtraction(A=multiplication, B=dist)
amp = Amplitude(Vector=vec2pt.Vector, Amplitude=subtraction_3)
move = Move(Geometry=midpt_3, Motion=amp)  # -> Geometry, Transform
panel_2 = Panel("""0
1""")
weave = Weave(Pattern=panel_2, Stream0=pt_6, Stream1=move.Geometry, NullGaps=False)

len_2 = Length(Curve=crv_4)
darc_2 = DeconstructArc(Arc=crv_4)  # -> BasePlane, Radius, Angle
division_3 = Division(A=len_2, B=number_slider_2)
round_2 = Round(Number=division_3)  # -> Nearest, Floor, Ceiling
divide_2 = DivideCurve(Curve=crv_4, Count=round_2.Floor, Kinks=False)  # -> Points, Tangents, Parameters
pline_2 = PolyLine(Vertices=divide_2.Points, Closed=False)
pt_8 = Point(divide_2.Points)
explode_2 = Explode(Curve=pline_2, Recursive=True)  # -> Segments, Vertices
midpt_4 = CurveMiddle(Curve=explode_2.Segments)
pt_9 = Point(darc_2.BasePlane)
vec2pt_2 = Vector2Pt(PointA=pt_9, PointB=midpt_4, Unitize=False)  # -> Vector, Length
dist_2 = Distance(PointA=pt_9, PointB=midpt_4)
division_4 = Division(A=darc_2.Radius, B=dist_2)
multiplication_2 = Multiplication(A=darc_2.Radius, B=division_4)
subtraction_4 = Subtraction(A=multiplication_2, B=dist_2)
amp_2 = Amplitude(Vector=vec2pt_2.Vector, Amplitude=subtraction_4)
move_2 = Move(Geometry=midpt_4, Motion=amp_2)  # -> Geometry, Transform
panel_3 = Panel("""0
1""")
weave_2 = Weave(Pattern=panel_3, Stream0=pt_8, Stream1=move_2.Geometry, NullGaps=False)

pline_3 = PolyLine(Vertices=weave, Closed=False)
points = PointList(Points=weave_2, Size=Slider(6616, range=0..10000))
points_2 = PointList(Points=weave, Size=Slider(6616, range=0..10000))
pline_4 = PolyLine(Vertices=weave_2, Closed=False)
panel_4 = Panel(weave)

# ---- group: 重複ポイントは削除しておく
cull_i = CullIndex(List=weave, Indices="-1", Wrap=True)

# ----
panel_5 = Panel(weave_2)
pt_10 = Point(weave_2)

# ---- group: 念のためFlatten
merge = Merge(Data1=flatten(cull_i), Data2=flatten(pt_10))

# ----
points_3 = PointList(Points=merge, Size=Slider(3618, range=0..10000))

# ---- group: Y軸ミラー
yz = YZPlane(Origin=Point(0, 0, 0))

# ---- group: 重複ポイントは削除しておく
cull_i_2 = CullIndex(List=merge, Indices="-1", Wrap=True)

# ---- group: X軸ミラー
xz = XZPlane(Origin=Point(0, 0, 0))

# ---- group: 段床奥行
F = Slider(1000, range=0..1000)

# ---- group: 段数
S = Slider(20, range=1..20)

# ---- group: 視点の背面距離
number_slider_3 = Slider(150, range=0..10000)

# ---- group: 段床蹴上
K = Slider(514, range=0..1000)

# ---- group: 建物中心からフォーカルポイントまでの水平距離
# （最終的に）スライダーは左側にまとめる
# 入力用の変数
P = Slider(65000, range=0..100000)

# ---- group: 1段目の高さ
D = Slider(1353, range=0..10000)

# ---- group: フォーカルポイントから最前列視点までの水平距離
A = Slider(9714.355, range=5000..20000)

# ---- group: 視点の高さ
E = Slider(1200, range=0..10000)

# ----
# 作図用の変数を準備
neg_3 = Negative(Value=P)
pt_11 = ConstructPoint(XCoordinate=neg_3, YCoordinate=0, ZCoordinate=0)

neg_4 = Negative(Value=E)
subtraction_5 = Subtraction(A=F, B=number_slider_3)
neg_5 = Negative(Value=number_slider_3)

# ---- group: フォーカルポイント
pt_12 = Point(pt_11)

# ---- group: 最前列視点
addition = Addition(A=E, B=D)
neg_6 = Negative(Value=A)
pt_13 = PointOriented(BasePlane=pt_12, UComponent=neg_6, VComponent=0, WComponent=addition)

# ---- group: 最前列の視点をもとにした2段目以降の視点
subtraction_6 = Subtraction(A=S, B="1")
series = Series(Start=K, Step=K, Count=subtraction_6)
series_2 = Series(Start=F, Step=F, Count=subtraction_6)
neg_7 = Negative(Value=series_2)
pt_14 = PointOriented(BasePlane=pt_13, UComponent=neg_7, VComponent=0, WComponent=series)

# ---- group: フォーカルポイント
# 重要なジオメトリに適宜名前を付けておく
# 作図1
pt_15 = Point(pt_12)

# ---- group: 最前列視点
pt_16 = Point(pt_13)

# ---- group: 2段目以降の視点
pt_17 = Point(pt_14)

# ---- group: 建物中心からフォーカルポイントまでの水平距離
num = Number(P)

# ---- group: サイトライン
ln_5 = Line(StartPoint=pt_15, EndPoint=pt_16)
ln_6 = Line(StartPoint=pt_15, EndPoint=pt_17)
merge_2 = Merge(Data1=flatten(ln_5), Data2=flatten(ln_6))

# ---- group: 人の位置
merge_3 = Merge(Data1=flatten(pt_16), Data2=flatten(pt_17))
pt_18 = PointOriented(BasePlane=merge_3, UComponent=0, VComponent=0, WComponent=neg_4)
ln_7 = Line(StartPoint=merge_3, EndPoint=pt_18)

# ---- group: スタンド断面
pt_19 = PointOriented(BasePlane=merge_3, UComponent=neg_5, VComponent=0, WComponent=neg_4)
pt_20 = PointOriented(BasePlane=merge_3, UComponent=subtraction_5, VComponent=0, WComponent=neg_4)
panel_6 = Panel("""0
1""")
weave_3 = Weave(Pattern=panel_6, Stream0=pt_20, Stream1=pt_19, NullGaps=False)

# ---- group: 最前列手すり
panel_7 = Panel("""0
0
150
150""")
panel_8 = Panel("""0
750
750
0""")
item = ListItem(List=weave_3, Index=0, Wrap=True)
pt_21 = PointOriented(BasePlane=item, UComponent=panel_7, VComponent=0, WComponent=panel_8)
pline_5 = PolyLine(Vertices=pt_21, Closed=False)

# ----
pline_6 = PolyLine(Vertices=weave_3, Closed=False)

# ---- group: サイトライン
# 段床・サイトライン
crv_5 = Curve(merge_2)

# ---- group: 人の位置
crv_6 = Curve(ln_7)

# ---- group: 最前列手すり
crv_7 = Curve(pline_5)

# ---- group: 入隅
pt_22 = Point(pt_19)

# ---- group: スタンド断面
crv_8 = Curve(pline_6)

# ---- group: レールのオフセット距離
number_slider_4 = Slider(200, range=0..1000)

# ----
swatch = ColourSwatch(SwatchColor=RGB(222, 222, 222))

# ---- group: 建物中心からフォーカルポイントまでの水平距離
num_2 = Number(num)

# ----
preview = CustomPreview(Geometry=crv_8, Material=swatch)
preview_2 = CustomPreview(Geometry=crv_7, Material=swatch)
preview_3 = CustomPreview(Geometry=crv_6, Material=ColourSwatch(SwatchColor=RGB(21, 255, 0)))
preview_4 = CustomPreview(Geometry=crv_5, Material=ColourSwatch(SwatchColor=RGB(255, 81, 0)))
merge_4 = Merge(Data1=Toggle(True), Data2=Toggle(False))

# ---- group: 最低限の座席のピッチ
P_2 = Slider(510, range=480..600)

# ----
num_3 = Number(P_2)

# ---- group: P/2
division_5 = Division(A=num_3, B="2")
num_4 = Number(division_5)

# ---- group: 5mmで丸める
division_6 = Division(A=num_4, B="5")
round_3 = Round(Number=division_6)  # -> Nearest, Floor, Ceiling
multiplication_3 = Multiplication(A=round_3.Floor, B="5")

# ----
neg_8 = Negative(Value=multiplication_3)
num_5 = Number(num_3)

# ---- group: 1列の最大席数
number_slider_5 = Slider(16, range=5..30)

# ---- group: スタンド断面
crv_9 = Curve(crv_8)

# ---- group: 最前列手すり
crv_10 = Curve(crv_7)

# ----
galapagos = Galapagos(fitness=num_8, gene=number_slider_2)
swatch_2 = ColourSwatch(SwatchColor=RGBA(141, 218, 227, 122))

mirror_2 = Mirror(Geometry=merge, Plane=yz)  # -> reverse(Geometry), Transform
points_4 = PointList(Points=mirror_2.Geometry, Size=Slider(3618, range=0..10000))

# ---- group: 念のためFlatten
merge_5 = Merge(Data1=flatten(cull_i_2), Data2=flatten(mirror_2.Geometry))

# ----
points_5 = PointList(Points=merge_5, Size=Slider(3618, range=0..10000))

# ---- group: 重複ポイントは削除しておく
# 外接なのでサイトラインは有利側
cull_i_3 = CullIndex(List=merge_5, Indices="-1", Wrap=True)

# ----
mirror_3 = Mirror(Geometry=merge_5, Plane=xz)  # -> reverse(Geometry), Transform
points_6 = PointList(Points=mirror_3.Geometry, Size=Slider(3618, range=0..10000))

# ---- group: 念のためFlatten
merge_6 = Merge(Data1=flatten(cull_i_3), Data2=flatten(mirror_3.Geometry))

# ----
points_7 = PointList(Points=merge_6, Size=Slider(3618, range=0..10000))

# ---- group: 多角形化したフォーカルライン
pline_7 = PolyLine(Vertices=merge_6, Closed=False)

# ----
preview_5 = CustomPreview(Geometry=pline_7, Material=ColourSwatch(SwatchColor=RGB(255, 0, 0)))
filter = StreamFilter(Gate=Toggle(True), Stream1=pline_7)

# ---- group: 動線配置 / 多角形化したフォーカルライン
crv_11 = Curve(filter)

# ---- group: 動線配置
通路幅 = Slider(2000, range=0..2000)
explode_3 = Explode(Curve=crv_11, Recursive=True)  # -> Segments, Vertices
partition = PartitionList(List=explode_3.Segments, Size=Slider(2, range=2..4))
division_7 = Division(A=通路幅, B="2")
join = JoinCurves(Curves=partition, Preserve=False)
neg_9 = Negative(Value=division_7)
ext_3 = ExtendCurve(Curve=join, Type=0, Start=neg_9, End=neg_9)

# ---- group: 多角形化したフォーカルライン
crv_12 = Curve(filter)

crv_13 = Curve(crv_12)

# ---- group: 放射方向の線
offset = OffsetCurve(Curve=crv_13, Distance="1000", Plane=PlaneXY(0, 0, 0), Corners=1)
explode_4 = Explode(Curve=crv_13, Recursive=True)  # -> Segments, Vertices
crv_cp = CurveClosestPoint(Point=explode_4.Vertices, Curve=offset)  # -> Point, Parameter, Distance
vec2pt_3 = Vector2Pt(PointA=crv_cp.Point, PointB=explode_4.Vertices, Unitize=False)  # -> Vector, Length
line = LineSDL(Start=explode_4.Vertices, Direction=vec2pt_3.Vector, Length=Slider(100000, range=0..100000))

# ---- group: 交線の配置位置
cull = CullPattern(List=line, CullPattern=invert(merge_4))

# ---- group: 断面の配置位置
cull_2 = CullPattern(List=line, CullPattern=merge_4)

# ----
preview_6 = CustomPreview(Geometry=cull_2, Material=ColourSwatch(SwatchColor=RGB(0, 72, 255)))
preview_7 = CustomPreview(Geometry=cull, Material=ColourSwatch(SwatchColor=RGB(255, 115, 0)))
end = EndPoints(Curve=cull)  # -> Start, End
pt_23 = PointOriented(BasePlane=end.Start, UComponent=0, VComponent=0, WComponent="100")
hframe = HorizontalFrame(Curve=cull_2, Parameter="0")
lnpt = LinePt(Line=cull, Point=pt_23)
pt_24 = PointOriented(BasePlane=hframe, UComponent=0, VComponent=Slider(10000, range=0..10000), WComponent=0)
points_8 = PointList(Points=hframe, Size=Slider(5119, range=0..10000))
points_9 = PointList(Points=lnpt, Size=Slider(5119, range=0..10000))

# ---- group: 配置先
cull_i_4 = CullIndex(List=hframe, Indices="-1", Wrap=True)

# ---- group: 起点
item_2 = ListItem(List=hframe, Index=0, Wrap=True)

# ----
shift = ShiftList(List=lnpt, Shift="-1", Wrap=True)
deplane = DeconstructPlane(Plane=cull_i_4)  # -> Origin, XAxis, YAxis, ZAxis
vec = Vector(deplane.YAxis)
rev_2 = Reverse(Vector=vec)

# ---- group: 起点
pln = Plane(item_2)

# ---- group: 配置先
pln_2 = Plane(cull_i_4)

# ---- group: 投影方向右
vec_2 = Vector(vec)

# ---- group: 投影面右
pln_3 = Plane(lnpt)

# ---- group: 投影方向左
vec_3 = Vector(rev_2)

# ---- group: 投影面左
pln_4 = Plane(shift)

# ----
entwine = Entwine(Branch00=pln, Branch01=pln_2, Branch02=vec_2, Branch03=vec_3, Branch04=pln_3, Branch05=pln_4, FlattenInputs=True)

# ----
# 起点以外のアイテム数が揃っていることを確認する
lng = ListLength(List=entwine)
panel_9 = Panel(lng)

# ---- group: 配置設定セット
data = Data(entwine)

data_2 = Data(data)

data_3 = Data(data)

# ----
pdecon = Deconstruct(Point=pt_22)  # -> XComponent, YComponent, ZComponent

# ---- group: 入隅のGLからの高さ
num_6 = Number(pdecon.ZComponent)

# ---- group: 入隅の水平距離
num_7 = Number(pdecon.XComponent)

# ----
addition_2 = Addition(A=num_2, B=num_7, C=number_slider_4)

offset_2 = OffsetCurve(Curve=ext_3, Distance=addition_2, Plane=PlaneXY(0, 0, 0), Corners=1)
Z = UnitZ(Factor=num_6)
pshift = ShiftPaths(Data=offset_2, Offset=-1)
move_3 = Move(Geometry=pshift, Motion=Z)  # -> Geometry, Transform
panel_10 = Panel(pshift)

# ---- group: 座席を取り付けるレール
crv_14 = Curve(move_3.Geometry)

crv_15 = Curve(graft(crv_14))

# ----
ext_4 = ExtendCurve(Curve=crv_15, Type=0, Start=neg_8, End=neg_8)
len_3 = Length(Curve=ext_4)
division_8 = Division(A=len_3, B=num_5)
round_4 = Round(Number=division_8)  # -> Nearest, Floor, Ceiling

# ---- group: 入る席数
int = Integer(round_4.Floor)

# ----
crv_16 = Curve(ext_4)

# ---- group: 入る席数
int_2 = Integer(int)

# ----
smaller = SmallerThan(FirstNumber=int_2, SecondNumber=number_slider_5)  # -> SmallerThan, OrEqualTo
cull_3 = CullPattern(List=number_slider_5, CullPattern=invert(smaller.OrEqualTo))
cull_4 = CullPattern(List=int_2, CullPattern=smaller.OrEqualTo)
merge_7 = Merge(Data1=cull_4, Data2=cull_3)

# ---- group: ぼっち席は作らない前提
subtraction_7 = Subtraction(A=merge_7, B="1")

# ----
divide_3 = DivideCurve(Curve=crv_16, Count=subtraction_7, Kinks=False)  # -> Points, Tangents, Parameters

# ---- group: 結果的に出た席ピッチ
item_3 = ListItem(List=divide_3.Points, Index=0, Wrap=True)  # -> Item, Item1
dist_3 = Distance(PointA=item_3.Item, PointB=item_3.Item1)

# ---- group: 席配置起点
hframe_2 = HorizontalFrame(Curve=crv_16, Parameter=divide_3.Parameters)

# ---- group: 見た目用
division_9 = Division(A=Slider(400, range=0..1000), B="2")
division_10 = Division(A=Slider(400, range=0..1000), B="2")
neg_10 = Negative(Value=division_9)
neg_11 = Negative(Value=division_10)
dom = ConstructDomain(DomainStart=division_9, DomainEnd=neg_10)
dom_2 = ConstructDomain(DomainStart=division_10, DomainEnd=neg_11)
rectangle = Rectangle(Plane=hframe_2, XSize=dom, YSize=dom_2, Radius=0)  # -> Rectangle, Length

# ----
lng_2 = ListLength(List=flatten(hframe_2))
席数 = Panel(lng_2)
num_8 = Number(lng_2)
preview_8 = CustomPreview(Geometry=rectangle.Rectangle, Material=ColourSwatch(SwatchColor=RGB(0, 0, 0)))

crv_17 = Curve(graft(crv_9))
bang = ExplodeTree(Data=data_2)  # -> Branch0, Branch1, Branch2, Branch3, Branch4, Branch5

# ---- group: 起点
pln_5 = Plane(bang.Branch0)

# ---- group: 投影方向右
vec_4 = Vector(bang.Branch2)

# ---- group: 投影面右
pln_6 = Plane(bang.Branch4)

# ---- group: 配置先
pln_7 = Plane(bang.Branch1)

# ---- group: 投影方向左
vec_5 = Vector(bang.Branch3)

# ---- group: 投影面左
pln_8 = Plane(bang.Branch5)

# ----
orient = Orient(Geometry=crv_17, Source=pln_5, Target=pln_7)  # -> Geometry, Transform
crv_18 = Curve(orient.Geometry)
projecta = ProjectAlong(Geometry=crv_18, Plane=pln_8, Direction=vec_5)  # -> graft(Geometry), Transform
projecta_2 = ProjectAlong(Geometry=crv_18, Plane=pln_6, Direction=vec_4)  # -> graft(Geometry), Transform
merge_8 = Merge(Data1=projecta_2.Geometry, Data2=projecta.Geometry)

panel_11 = Panel(merge_8)

crv_19 = Curve(graft(crv_10))
bang_2 = ExplodeTree(Data=data_3)  # -> Branch0, Branch1, Branch2, Branch3, Branch4, Branch5

# ---- group: 起点
pln_9 = Plane(bang_2.Branch0)

# ---- group: 投影方向右
vec_6 = Vector(bang_2.Branch2)

# ---- group: 配置先
pln_10 = Plane(bang_2.Branch1)

# ---- group: 投影方向左
vec_7 = Vector(bang_2.Branch3)

# ---- group: 投影面右
pln_11 = Plane(bang_2.Branch4)

# ---- group: 投影面左
pln_12 = Plane(bang_2.Branch5)

# ----
orient_2 = Orient(Geometry=crv_19, Source=pln_9, Target=pln_10)  # -> Geometry, Transform
crv_20 = Curve(orient_2.Geometry)
projecta_3 = ProjectAlong(Geometry=crv_20, Plane=pln_12, Direction=vec_7)  # -> graft(Geometry), Transform
projecta_4 = ProjectAlong(Geometry=crv_20, Plane=pln_11, Direction=vec_6)  # -> graft(Geometry), Transform
merge_9 = Merge(Data1=projecta_4.Geometry, Data2=projecta_3.Geometry)

# ----
# Loft前セーブとON/OFFスイッチ
toggle = BooleanToggle(True)
filter_2 = StreamFilter(Gate=toggle, Stream1=merge_8)
filter_3 = StreamFilter(Gate=toggle, Stream1=merge_9)

loft = Loft(Curves=filter_2, Options={Adjust=False, Closed=False, LoftEnds=0, LoftSimp=0, LoftType=0, Rebuild=10, Refit=0.01})
loft_2 = Loft(Curves=filter_3, Options={Adjust=False, Closed=False, LoftEnds=0, LoftSimp=0, LoftType=0, Rebuild=10, Refit=0.01})
preview_9 = CustomPreview(Geometry=loft, Material=swatch_2)
preview_10 = CustomPreview(Geometry=loft_2, Material=swatch_2)
