# Grasshopper definition Grasshopper WorkhopHandsOn.gh (Grasshopper 1.0.7)

# ---- group: Y軸方向の距離
fy = Slider(100000, range=0..100000)

# ---- group: X軸方向の距離
fx = Slider(65000, range=0..100000)

# ---- group: 第2円弧半径
R = Slider(57940, range=0..100000)

# ----
subtraction = Subtraction()
neg = Negative()
subtraction_2 = Subtraction()
neg_2 = Negative()
pt = PointOriented(BasePlane=PlaneXY(0, 0, 0), UComponent=0, VComponent=0, WComponent=0)
pt_2 = PointOriented(BasePlane=PlaneXY(0, 0, 0), UComponent=0, VComponent=0, WComponent=0)
pt_3 = PointOriented(BasePlane=PlaneXY(0, 0, 0), UComponent=0, VComponent=0, WComponent=0)
pt_4 = PointOriented(BasePlane=PlaneXY(0, 0, 0), UComponent=0, VComponent=0, WComponent=0)

# ---- group: 見た目用
pt_5 = ConstructPoint(XCoordinate=0, YCoordinate=0, ZCoordinate=0)
ln = Line()

# ----
# グループ化してコピーで使った方が扱いやすい
relay = Relay()
tag = TextTag3D(
    Location=relay,
    Text="FX",
    Size=Slider(7000, range=0..10000),
    Colour=ColourSwatch(SwatchColor=RGB(8, 0, 255)),
    Justification=7)

relay_2 = Relay()
tag_2 = TextTag3D(
    Location=relay_2,
    Text="FY",
    Size=Slider(7000, range=0..10000),
    Colour=ColourSwatch(SwatchColor=RGB(8, 0, 255)),
    Justification=7)

ln_2 = Line()
relay_3 = Relay()
relay_4 = Relay()
relay_5 = Relay()
panel = Panel("0.5")
pframe = PerpFrame()
mirror = Mirror(Plane=PlaneYZ(0, 0, 0))  # -> Geometry, Transform
relay_6 = Relay()
X = UnitX(Factor=1)
Y = UnitY(Factor=1)
rev = Reverse()
arc = ArcSED()  # -> Arc, Plane, Radius
arc_2 = ArcSED()  # -> Arc, Plane, Radius

# ---- group: 見た目用
ln_3 = Line()
ln_4 = Line()

number_slider = Slider(1000000, range=0..1000000)
panel_2 = Panel("0")
ext = ExtendCurve(Type=0)
ext_2 = ExtendCurve(Type=0)

# ----
flip = FlipCurve()  # -> Curve, Flag
midpt = CurveMiddle()
midpt_2 = CurveMiddle()

relay_7 = Relay()
# フォーカルライン（円弧）
tag_3 = TextTag3D(
    Location=relay_7,
    Text="①",
    Size=Slider(7000, range=0..10000),
    Colour=ColourSwatch(SwatchColor=RGB(8, 0, 255)),
    Justification=7)

relay_8 = Relay()
tag_4 = TextTag3D(
    Location=relay_8,
    Text="②",
    Size=Slider(7000, range=0..10000),
    Colour=ColourSwatch(SwatchColor=RGB(8, 0, 255)),
    Justification=7)

# ---- group: 第1円弧
crv = Curve()

# ---- group: 第2円弧
crv_2 = Curve()

# ---- group: 本来は最前列の長さや最上段の長さをもとに分割数を出す。
# 割り算の分母は０にならないように設定しておく
number_slider_2 = Slider(7820, range=4000..30000)

# ---- group: 第1円弧
crv_3 = Curve()

# ---- group: 第2円弧
crv_4 = Curve()

# ----
# コピーの数が少なければデザイングループとして扱う。多い時はクラスター化も考え始める
relay_9 = Relay()
relay_10 = Relay()
len = Length()
darc = DeconstructArc()  # -> BasePlane, Radius, Angle
division = Division()
round = Round()  # -> Nearest, Floor, Ceiling
divide = DivideCurve(Count=10, Kinks=False)  # -> Points, Tangents, Parameters
pline = PolyLine(Closed=False)
pt_6 = Point()
explode = Explode(Recursive=True)  # -> Segments, Vertices
midpt_3 = CurveMiddle()
pt_7 = Point()
vec2pt = Vector2Pt(Unitize=False)  # -> Vector, Length
dist = Distance()
relay_11 = Relay()
division_2 = Division()
multiplication = Multiplication()
subtraction_3 = Subtraction()
amp = Amplitude(Amplitude=1)
move = Move(Motion=Vector(0, 0, 10))  # -> Geometry, Transform
panel_4 = Panel("""0
1""")
weave = Weave(Pattern=panel_4, Stream1=move.Geometry, NullGaps=False)

relay_12 = Relay()
relay_13 = Relay()
len_2 = Length()
darc_2 = DeconstructArc()  # -> BasePlane, Radius, Angle
division_3 = Division()
round_2 = Round()  # -> Nearest, Floor, Ceiling
divide_2 = DivideCurve(Count=10, Kinks=False)  # -> Points, Tangents, Parameters
pline_2 = PolyLine(Closed=False)
pt_8 = Point()
explode_2 = Explode(Recursive=True)  # -> Segments, Vertices
midpt_4 = CurveMiddle()
pt_9 = Point()
vec2pt_2 = Vector2Pt(Unitize=False)  # -> Vector, Length
dist_2 = Distance()
relay_14 = Relay()
division_4 = Division()
multiplication_2 = Multiplication()
subtraction_4 = Subtraction()
amp_2 = Amplitude(Amplitude=1)
move_2 = Move(Motion=Vector(0, 0, 10))  # -> Geometry, Transform
panel_5 = Panel("""0
1""")
weave_2 = Weave(Pattern=[0, 1], NullGaps=False)

number_slider_3 = Slider(6616, range=0..10000)
number_slider_4 = Slider(6616, range=0..10000)
pline_3 = PolyLine(Closed=False)
points = PointList()
points_2 = PointList()
pline_4 = PolyLine(Closed=False)

# ---- group: 重複ポイントは削除しておく
panel_6 = Panel("-1")
cull_i = CullIndex(Wrap=True)

# ----
pt_10 = Point()
number_slider_5 = Slider(3618, range=0..10000)

# ---- group: 念のためFlatten
merge = Merge()

# ----
points_3 = PointList()

relay_15 = Relay()
number_slider_6 = Slider(3618, range=0..10000)
mirror_2 = Mirror(Plane=PlaneYZ(0, 0, 0))  # -> reverse(Geometry), Transform
points_4 = PointList()
number_slider_7 = Slider(3618, range=0..10000)
points_5 = PointList()

# ---- group: Y軸ミラー
yz = YZPlane(Origin=Point(0, 0, 0))

# ---- group: 重複ポイントは削除しておく
cull_i_2 = CullIndex(Wrap=True)

# ---- group: 念のためFlatten
merge_2 = Merge()

# ----
relay_16 = Relay()
number_slider_8 = Slider(3618, range=0..10000)
mirror_3 = Mirror(Plane=PlaneYZ(0, 0, 0))  # -> reverse(Geometry), Transform
points_6 = PointList()
number_slider_9 = Slider(3618, range=0..10000)
points_7 = PointList()

# ---- group: X軸ミラー
xz = XZPlane(Origin=Point(0, 0, 0))

# ---- group: 重複ポイントは削除しておく
# 外接なのでサイトラインは有利側
cull_i_3 = CullIndex(Wrap=True)

# ---- group: 念のためFlatten
merge_3 = Merge()

# ---- group: 段床奥行
F = Slider(1000, range=0..1000)

# ---- group: 段数
S = Slider(20, range=1..20)

# ---- group: 視点の背面距離
number_slider_10 = Slider(150, range=0..10000)

# ---- group: 段床蹴上
K = Slider(514, range=0..1000)

# ---- group: 建物中心からフォーカルポイントまでの水平距離
# （最終的に）スライダーは左側にまとめる
# 入力用の変数
P = Slider(65000, range=0..100000)

# ---- group: 1段目の高さ
D = Slider(1353, range=0..10000)

# ---- group: フォーカルポイントから最前列視点までの水平距離
A = Slider(9714.355, range=5000..20000)

# ---- group: 視点の高さ
E = Slider(1200, range=0..10000)

# ----
swatch = ColourSwatch(SwatchColor=RGB(255, 0, 0))

# ---- group: 多角形化したフォーカルライン
pline_5 = PolyLine(Closed=False)

# ----
preview = CustomPreview(Material={diffuse=RGB(221, 160, 221), emission=RGB(66, 48, 66), shine=0.5, specular=RGB(255, 255, 255), transparency=0})
toggle = BooleanToggle(True)

# ----
# 作図用の変数を準備
neg_3 = Negative()
pt_11 = ConstructPoint(XCoordinate=0, YCoordinate=0, ZCoordinate=0)

# ---- group: 最前列視点
addition = Addition()
neg_4 = Negative()
pt_12 = PointOriented(BasePlane=PlaneXY(0, 0, 0), UComponent=0, VComponent=0, WComponent=0)

# ----
relay_17 = Relay()
relay_18 = Relay()

# ---- group: 最前列の視点をもとにした2段目以降の視点
panel_9 = Panel("1")
subtraction_5 = Subtraction()
series = Series(Start=0, Step=1, Count=10)
series_2 = Series(Start=0, Step=1, Count=10)
neg_5 = Negative()
pt_13 = PointOriented(BasePlane=PlaneXY(0, 0, 0), UComponent=0, VComponent=0, WComponent=0)

# ----
neg_6 = Negative()
subtraction_6 = Subtraction()
neg_7 = Negative()
filter = StreamFilter(Gate=0)

# ---- group: フォーカルポイント
pt_14 = Point()

# 重要なジオメトリに適宜名前を付けておく
# 作図1
pt_15 = Point()

# ---- group: 最前列視点
pt_16 = Point()

# ---- group: 2段目以降の視点
pt_17 = Point()

# ----
relay_19 = Relay()

# ---- group: 建物中心からフォーカルポイントまでの水平距離
num = Number()

# ---- group: サイトライン
ln_5 = Line()
ln_6 = Line()
merge_4 = Merge()

# ---- group: 人の位置
merge_5 = Merge()
relay_20 = Relay()
pt_18 = PointOriented(BasePlane=PlaneXY(0, 0, 0), UComponent=0, VComponent=0, WComponent=0)
ln_7 = Line()

# ---- group: スタンド断面
relay_21 = Relay()
pt_19 = PointOriented(BasePlane=PlaneXY(0, 0, 0), UComponent=0, VComponent=0, WComponent=0)
pt_20 = PointOriented(BasePlane=PlaneXY(0, 0, 0), UComponent=0, VComponent=0, WComponent=0)
weave_3 = Weave(Pattern=[0, 1], NullGaps=False)

# ----
relay_22 = Relay()

# ---- group: 最前列手すり
panel_11 = Panel("""0
0
150
150""")
panel_12 = Panel("""0
750
750
0""")
item = ListItem(Index=0, Wrap=True)
pt_21 = PointOriented(BasePlane=PlaneXY(0, 0, 0), UComponent=0, VComponent=0, WComponent=0)
pline_6 = PolyLine(Closed=False)

# ----
pline_7 = PolyLine(Closed=False)

# ---- group: サイトライン
# 段床・サイトライン
crv_5 = Curve()

# ---- group: 人の位置
crv_6 = Curve()

# ---- group: 最前列手すり
crv_7 = Curve()

# ---- group: 入隅
pt_22 = Point()

# ---- group: スタンド断面
crv_8 = Curve()

# ---- group: 動線配置 / 多角形化したフォーカルライン
crv_9 = Curve()

# ---- group: 動線配置
通路幅 = Slider(2000, range=0..2000)
number_slider_11 = Slider(2, range=2..4)
explode_3 = Explode(Recursive=True)  # -> Segments, Vertices
panel_13 = Panel("2")
partition = PartitionList(Size=[3, 2])
division_5 = Division()
join = JoinCurves(Preserve=False)
neg_8 = Negative()
ext_3 = ExtendCurve(Type=0)

# ---- group: 多角形化したフォーカルライン
crv_10 = Curve()

# ----
pdecon = Deconstruct()  # -> XComponent, YComponent, ZComponent
addition_2 = Addition()
relay_23 = Relay()

# ---- group: レールのオフセット距離
number_slider_12 = Slider(200, range=0..1000)

# ----
swatch_2 = ColourSwatch(SwatchColor=RGB(222, 222, 222))

# ---- group: 建物中心からフォーカルポイントまでの水平距離
num_2 = Number()

# ---- group: 入隅のGLからの高さ
num_3 = Number()

# ---- group: 入隅の水平距離
num_4 = Number()

# ----
preview_2 = CustomPreview(Material=swatch_2)
preview_3 = CustomPreview(Material=swatch_2)
preview_4 = CustomPreview(Material=ColourSwatch(SwatchColor=RGB(21, 255, 0)))
preview_5 = CustomPreview(Material=ColourSwatch(SwatchColor=RGB(255, 81, 0)))

# ---- group: 多角形化したフォーカルライン
crv_11 = Curve()

# ----
offset = OffsetCurve(Distance=1, Plane=PlaneXY(0, 0, 0), Corners=1)
Z = UnitZ(Factor=1)

# ---- group: 放射方向の線
panel_14 = Panel("1000")
offset_2 = OffsetCurve(Distance=1, Plane=PlaneXY(0, 0, 0), Corners=1)
explode_4 = Explode(Recursive=True)  # -> Segments, Vertices
crv_cp = CurveClosestPoint()  # -> Point, Parameter, Distance
number_slider_13 = Slider(100000, range=0..100000)
vec2pt_3 = Vector2Pt(Unitize=False)  # -> Vector, Length
line = LineSDL(Direction=Vector(0, 0, 1), Length=1)

# ----
pshift = ShiftPaths(Offset=-1)
move_3 = Move(Motion=Vector(0, 0, 10))  # -> Geometry, Transform

# ---- group: 座席を取り付けるレール
crv_12 = Curve()

# ----
toggle_2 = BooleanToggle(True)
toggle_3 = BooleanToggle(False)
merge_6 = Merge()

# ---- group: 交線の配置位置
cull = CullPattern(CullPattern=invert([False, False, True, True]))

# ---- group: 断面の配置位置
cull_2 = CullPattern(CullPattern=[False, False, True, True])

# ---- group: 最低限の座席のピッチ
P_2 = Slider(510, range=480..600)

# ----
swatch_3 = ColourSwatch(SwatchColor=RGB(0, 72, 255))

# ---- group: 座席を取り付けるレール
crv_13 = Curve()

# ----
preview_6 = CustomPreview(Material={diffuse=RGB(221, 160, 221), emission=RGB(66, 48, 66), shine=0.5, specular=RGB(255, 255, 255), transparency=0})
preview_7 = CustomPreview(Material=ColourSwatch(SwatchColor=RGB(255, 115, 0)))
end = EndPoints()  # -> Start, End
panel_15 = Panel("100")
num_5 = Number()

# ---- group: P/2
division_6 = Division()
num_6 = Number()

# ----
pt_23 = PointOriented(BasePlane=PlaneXY(0, 0, 0), UComponent=0, VComponent=0, WComponent=0)
number_slider_14 = Slider(5119, range=0..10000)
hframe = HorizontalFrame()
lnpt = LinePt()
pt_24 = PointOriented(BasePlane=PlaneXY(0, 0, 0), UComponent=0, VComponent=Slider(10000, range=0..10000), WComponent=0)

# ---- group: 5mmで丸める
panel_18 = Panel("5")
division_7 = Division()
round_3 = Round()  # -> Nearest, Floor, Ceiling
multiplication_3 = Multiplication()

# ----
points_8 = PointList()
points_9 = PointList(Size=Slider(5119, range=0..10000))

# ---- group: 配置先
cull_i_4 = CullIndex(Wrap=True)

# ---- group: 起点
item_2 = ListItem(Index=0, Wrap=True)

# ----
shift = ShiftList(Shift=1, Wrap=True)
deplane = DeconstructPlane(Plane=PlaneXY(0, 0, 0))  # -> Origin, XAxis, YAxis, ZAxis
neg_9 = Negative()
vec = Vector()
ext_4 = ExtendCurve(Type=0)
rev_2 = Reverse()
relay_24 = Relay()
len_3 = Length()
num_7 = Number()
division_8 = Division()

# ---- group: 起点
pln = Plane()

# ---- group: 配置先
pln_2 = Plane()

# ---- group: 投影方向右
vec_2 = Vector()

# ---- group: 投影面右
pln_3 = Plane()

# ---- group: 投影方向左
vec_3 = Vector()

# ---- group: 投影面左
pln_4 = Plane()

# ----
round_4 = Round()  # -> Nearest, Floor, Ceiling

# ---- group: 入る席数
int = Integer()

# ----
crv_14 = Curve()

# ---- group: 1列の最大席数
number_slider_15 = Slider(16, range=5..30)

# ----
entwine = Entwine(FlattenInputs=True)

# ---- group: 入る席数
int_2 = Integer()

# ----
# 起点以外のアイテム数が揃っていることを確認する
lng = ListLength()

# ---- group: 配置設定セット
data = Data()

# ----
smaller = SmallerThan(SecondNumber=0)  # -> SmallerThan, OrEqualTo
cull_3 = CullPattern(CullPattern=invert([False, False, True, True]))
cull_4 = CullPattern(CullPattern=[False, False, True, True])
merge_7 = Merge()

# ---- group: ぼっち席は作らない前提
subtraction_7 = Subtraction()

# ---- group: 見た目用
number_slider_16 = Slider(400, range=0..1000)
number_slider_17 = Slider(400, range=0..1000)
division_9 = Division()
division_10 = Division()
neg_10 = Negative()
neg_11 = Negative()
dom = ConstructDomain(DomainStart=0, DomainEnd=1)
dom_2 = ConstructDomain(DomainStart=0, DomainEnd=1)
rectangle = Rectangle(Plane=PlaneXY(0, 0, 0), XSize=Domain(-1, 1), YSize=Domain(-2, 2), Radius=0)  # -> Rectangle, Length

# ----
divide_3 = DivideCurve(Count=10, Kinks=False)  # -> Points, Tangents, Parameters

# ---- group: スタンド断面
crv_15 = Curve()

# ---- group: 配置設定セット
data_2 = Data()

# ---- group: 最前列手すり
crv_16 = Curve()

# ---- group: 配置設定セット
data_3 = Data()

# ---- group: 結果的に出た席ピッチ
item_3 = ListItem(Index=0, Wrap=True)  # -> Item, Item1
dist_3 = Distance()

# ---- group: 席配置起点
hframe_2 = HorizontalFrame()

# ----
crv_17 = Curve()
bang = ExplodeTree()  # -> Branch0, Branch1, Branch2, Branch3, Branch4, Branch5
orient = Orient(Source=PlaneXY(0, 0, 0), Target=PlaneXY(0, 0, 0))  # -> Geometry, Transform
crv_18 = Curve()
projecta = ProjectAlong(Plane=PlaneXY(0, 0, 0), Direction=Vector(0, 0, -1))  # -> graft(Geometry), Transform
projecta_2 = ProjectAlong(Plane=PlaneXY(0, 0, 0), Direction=Vector(0, 0, -1))  # -> graft(Geometry), Transform
merge_8 = Merge()

crv_19 = Curve()
bang_2 = ExplodeTree()  # -> Branch0, Branch1, Branch2, Branch3, Branch4, Branch5
orient_2 = Orient(Source=PlaneXY(0, 0, 0), Target=PlaneXY(0, 0, 0))  # -> Geometry, Transform
crv_20 = Curve()
projecta_3 = ProjectAlong(Plane=PlaneXY(0, 0, 0), Direction=Vector(0, 0, -1))  # -> graft(Geometry), Transform
projecta_4 = ProjectAlong(Plane=PlaneXY(0, 0, 0), Direction=Vector(0, 0, -1))  # -> graft(Geometry), Transform
merge_9 = Merge()

lng_2 = ListLength()

# ---- group: 起点
pln_5 = Plane()

# ---- group: 投影方向右
vec_4 = Vector()

# ---- group: 投影面右
pln_6 = Plane()

# ---- group: 配置先
pln_7 = Plane()

# ---- group: 投影方向左
vec_5 = Vector()

# ---- group: 投影面左
pln_8 = Plane()

# ---- group: 起点
pln_9 = Plane()

# ---- group: 投影方向右
vec_6 = Vector()

# ---- group: 配置先
pln_10 = Plane()

# ---- group: 投影方向左
vec_7 = Vector()

# ---- group: 投影面右
pln_11 = Plane()

# ---- group: 投影面左
pln_12 = Plane()

# ----
swatch_4 = ColourSwatch(SwatchColor=RGB(0, 0, 0))
num_8 = Number()
preview_8 = CustomPreview(Material={diffuse=RGB(221, 160, 221), emission=RGB(66, 48, 66), shine=0.5, specular=RGB(255, 255, 255), transparency=0})
galapagos = Galapagos(fitness=num_8, gene=number_slider_2)

# ----
# Loft前セーブとON/OFFスイッチ
toggle_4 = BooleanToggle(True)
filter_2 = StreamFilter(Gate=0)
filter_3 = StreamFilter(Gate=0)

loft = Loft(Options={Adjust=False, Closed=False, LoftEnds=0, LoftSimp=0, LoftType=0, Rebuild=10, Refit=0.01})
loft_2 = Loft(Options={Adjust=False, Closed=False, LoftEnds=0, LoftSimp=0, LoftType=0, Rebuild=10, Refit=0.01})
swatch_5 = ColourSwatch(SwatchColor=RGBA(141, 218, 227, 122))
preview_9 = CustomPreview(Material={diffuse=RGB(221, 160, 221), emission=RGB(66, 48, 66), shine=0.5, specular=RGB(255, 255, 255), transparency=0})
preview_10 = CustomPreview(Material={diffuse=RGB(221, 160, 221), emission=RGB(66, 48, 66), shine=0.5, specular=RGB(255, 255, 255), transparency=0})
